# Grasshopper definition Timber-preview.ghx (Grasshopper 1.0.8)
# plug-ins: Woodie

flat = FlatBoardMm(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)
bowed = UpwardBowedBoardMm(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)
guide = LongitudinalBendGuide(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)
# Woodie · Timber preview: WOODIE | TIMBER PREVIEW
# 
# Use a millimetre Rhino document.
# Choose Product / Appearance on Timber Material.
# The triangle below its icon hides the controls.
# 
# Flat and bowed boards: same centreline length,
# 500 x 27 mm section; 220 mm bow rise.
# Guide Curve controls longitudinal grain.
# 
# Visual presets only: changing Product does not
# change geometry or specify a manufactured layup.
timbermaterial = TimberMaterial(Seed=0, Resolution=2, Advanced=False, PanelExpanded=True, SelectedLook=1, SelectedProduct=1, WoodieMaterialVersion=3)  # -> Settings, Product
flat_timber = TimberPreview(Geometry=flat, Settings=timbermaterial.Settings, BasePlane=PlaneXY(0, 0, 0), Show=True)  # -> Meshes, Products, AlignedBox, Frame
bowed_timber = TimberPreview(Geometry=bowed, Settings=timbermaterial.Settings, BasePlane=PlaneXY(0, 0, 0), GuideCurve=guide, Show=True)  # -> Meshes, Products, AlignedBox, Frame
